# Grasshopper definition data_visualize.gh (Grasshopper 1.0.7)
# plug-ins: Human, Pufferfish

filter = StreamFilter(Gate=Toggle(True), Stream0="nodes_in", Stream1="nodes_out")
python = GhPythonScript(index=Slider(0, range=0..30000), data_type=filter)  # -> out, num_items, cur_json, a; inputs index: Int32
# ---------- python: Python ----------
__author__ = "YYang"
__version__ = "2022.11.05"

import rhinoscriptsyntax as rs
import Rhino.Geometry as rg
import json
import os

gh_path = ghdoc.Path
split_gh_path = gh_path.split('\\')
split_gh_path.pop(-1)
print split_gh_path
split_gh_path.append('data\\room_base_graph\\{}'.format(data_type))
path_to_json = '\\'.join(split_gh_path)
print path_to_json
#path_to_json = 'C:\\Users\\yyang\\Documents\\github\\BoxStacker\\data\\room_base_graph\\{}'.format(data_type)
json_files = [pos_json for pos_json in os.listdir(path_to_json) if pos_json.endswith('.json')]

print(json_files[index])
cur_json = json_files[index]
cur_path = 'C:\\Users\\yyang\\Documents\\github\\BoxStacker\\data\\large_sample_model\\nodes_in\\0.json'

with open (cur_path, 'r') as f:
    data = json.load(f)
    polylines = []
    for item in data['corners']:
        polyline = rg.Polyline()
        for pt in item:
            print pt
            cur_pt = rg.Point3d(pt[0], pt[1], 0)
            polyline.Add(cur_pt)
        polylines.append(polyline)
a = polylines
num_items = len(json_files)
# ---------- end python ----------
crv = Curve([<curve referenced from the Rhino model> x31])
python_2 = GhPythonScript(index=Slider(0, range=0..100))  # -> out, a, b, c; inputs index: Int32
# ---------- python_2: Python ----------
__author__ = "YYang"
__version__ = "2022.11.06"

import rhinoscriptsyntax as rs
import Rhino.Geometry as rg
import csv

with open('C:\\Users\\yyang\\Documents\\github\\BoxStacker\\sample_test_data\\pred_csv_test\\nodes_out\\{}.csv'.format(index),'r') as f:
    reader = csv.reader(f, delimiter=',', quoting=csv.QUOTE_NONE)
    polylines = []
    for row in reader:
        polyline = rg.Polyline()
        for i in range(len(row)):
            if(i%2 == 0):
                x = float(row[i])
                y = float(row[i+1])
                cur_pt = rg.Point3d(x, y, 0)
                polyline.Add(cur_pt)
        polyline.Add(polyline[0])
        polylines.append(polyline)
a = polylines

with open('C:\\Users\\yyang\\Documents\\github\\BoxStacker\\sample_test_data\\pred_csv_test\\nodes_out_gt\\{}.csv'.format(index),'r') as f:
    reader = csv.reader(f, delimiter=',', quoting=csv.QUOTE_NONE)
    pred_polylines = []
    for row in reader:
        polyline = rg.Polyline()
        for i in range(len(row)):
            if(i%2 == 0):
                x = float(row[i])
                y = float(row[i+1])
                cur_pt = rg.Point3d(x, y, 0)
                polyline.Add(cur_pt)
        polyline.Add(polyline[0])
        pred_polylines.append(polyline)
b = pred_polylines


with open('C:\\Users\\yyang\\Documents\\github\\BoxStacker\\sample_test_data\\pred_csv_test\\nodes_in\\{}.csv'.format(index),'r') as f:
    reader = csv.reader(f, delimiter=',', quoting=csv.QUOTE_NONE)
    in_polylines = []
    for row in reader:
        polyline = rg.Polyline()
        for i in range(len(row)):
            if(i%2 == 0):
                x = float(row[i])
                y = float(row[i+1])
                cur_pt = rg.Point3d(x, y, 0)
                polyline.Add(cur_pt)
        polyline.Add(polyline[0])
        in_polylines.append(polyline)
c = in_polylines
# ---------- end python_2 ----------
crv_2 = Curve([<curve referenced from the Rhino model> x31])
python_3 = GhPythonScript(boxes=crv_2)  # -> out, a; inputs boxes: list of Polyline
# ---------- python_3: Python ----------
__author__ = "YYang"
__version__ = "2022.11.06"

import rhinoscriptsyntax as rs
import Rhino.Geometry as rg
import json

out_node_data = {"corners":[]}

for box in boxes:
    cur_pts = box.ToArray()
    cur_corners = []
    for pt in cur_pts:
        cur_xy = [pt.X, pt.Y]
        cur_corners.append(cur_xy)
    out_node_data['corners'].append(cur_corners)

with open('C:\\Users\\yyang\\Documents\\github\\BoxStacker\\data\\large_sample_model\\nodes_out\\0.json','w') as f:
    data = json.dump(out_node_data, f)

def is_edge(cur_node, other_node):
        isEdge = False
        intersection = rg.Intersect.Intersection.CurveCurve(cur_node.ToNurbsCurve(), other_node.ToNurbsCurve(), 0.00000001, 0.00000001)
        if(len(intersection) == 1):
            isEdge = True
        return isEdge

def create_json_data(boxes):
    output_edges_data = {"adjacency": []}
    i = 0
    for box in boxes:
        j = 0
        for otherbox in boxes:
            if(i != j):
                isCreateEdge = is_edge(box, otherbox)
                if(isCreateEdge):
                    cur_edge = [i, j]
                    output_edges_data["adjacency"].append(cur_edge)
            j += 1
        i += 1
    return output_edges_data

edges = create_json_data(boxes)

with open('C:\\Users\\yyang\\Documents\\github\\BoxStacker\\data\\large_sample_model\\edges\\0.json','w') as f:
    data = json.dump(edges, f)

a = out_node_data['corners'][0][0]
# ---------- end python_3 ----------
python_4 = GhPythonScript(boxes=crv)  # -> out, a; inputs boxes: list of Polyline
# ---------- python_4: Python ----------
__author__ = "YYang"
__version__ = "2022.11.06"

import rhinoscriptsyntax as rs
import Rhino.Geometry as rg
import json

in_node_data = {"corners":[]}

for box in boxes:
    cur_pts = box.ToArray()
    cur_corners = []
    for pt in cur_pts:
        cur_xy = [pt.X, pt.Y]
        cur_corners.append(cur_xy)
    in_node_data['corners'].append(cur_corners)

with open('C:\\Users\\yyang\\Documents\\github\\BoxStacker\\data\\large_sample_model\\nodes_in\\0.json','w') as f:
    data = json.dump(in_node_data, f)

a = in_node_data['corners'][0][0]
# ---------- end python_4 ----------
panel = Panel(python.cur_json)
panel_2 = Panel(python.num_items)
swatch = ColourSwatch(SwatchColor=RGB(221, 0, 0))
swatch_2 = ColourSwatch(SwatchColor=RGB(0, 0, 0))
item = ListItem(List=python_3.a, Index=0, Wrap=True)  # -> Item, Item1
item_2 = ListItem(List=python_4.a, Index=0, Wrap=True)  # -> Item, Item1
swatch_3 = ColourSwatch(SwatchColor=RGB(0, 255, 0))
crv_3 = Curve(python_2.c)
crv_4 = Curve(python_2.b)
crv_5 = Curve(python_2.a)
pt = ConstructPoint(XCoordinate=item.Item, YCoordinate=item.Item1, ZCoordinate=0)
pt_2 = ConstructPoint(XCoordinate=item_2.Item, YCoordinate=item_2.Item1, ZCoordinate=0)
fixed = CustomPreviewLineweights(Geometry=crv_5, Shader=swatch_3, Thickness=Slider(3, range=0..10), Absolute=False)
gt = CustomPreviewLineweights(Geometry=crv_4, Shader=swatch_2, Thickness=Slider(3, range=0..10), Absolute=False)
broken = CustomPreviewLineweights(Geometry=crv_3, Shader=swatch, Thickness=Slider(3, range=0..10), Absolute=False)
explode = Explode(Curve=python_2.a, Recursive=True)  # -> Segments, Vertices
explode_2 = Explode(Curve=python_2.c, Recursive=True)  # -> Segments, Vertices
explode_3 = Explode(Curve=python_2.b, Recursive=True)  # -> Segments, Vertices
dist = Distance(PointA=explode.Vertices, PointB=explode_2.Vertices)
dist_2 = Distance(PointA=explode_3.Vertices, PointB=explode_2.Vertices)
division = Division(A=dist_2, B=dist)  # -> flatten(Result)
panel_3 = Panel(dist)
panel_4 = Panel(dist_2)
panel_5 = Panel(division)
equals = Equality(FirstNumber=panel_5, SecondNumber="0")  # -> Equality, Inequality
dispatch = Dispatch(List=panel_5, DispatchPattern=equals.Equality)  # -> ListA, ListB
panel_6 = Panel(dispatch.ListB)
num = Number(dispatch.ListB)
subtraction = Subtraction(A="1", B=dispatch.ListB)
abs = Absolute(Value=subtraction)
subtraction_2 = Subtraction(A=abs, B="1")
abs_2 = Absolute(Value=subtraction_2)
panel_7 = Panel(abs_2)
num_2 = Number(panel_7)
avr = Average(Input=num_2)
bbox = BoundingBox(Content=crv_3, Plane=PlaneXY(0, 0, 0), UnionBox=True)  # -> Box, Box_2
debrep = DeconstructBrep(Brep=bbox.Box)  # -> Faces, Edges, Vertices
Y = UnitY(Factor="-2")
roundd = RoundToDecimalPlace(NumberX=avr, DecimalPlace=2, RoundType=0)  # -> Rounded, Difference
move = Move(Geometry=debrep.Vertices, Motion=Y)  # -> Geometry, Transform
crv_6 = Curve(<curve referenced from the Rhino model>)  # disabled
crv_7 = Curve(<curve referenced from the Rhino model>)  # disabled
crv_8 = Curve(<curve referenced from the Rhino model>)  # disabled
concat = Concatenate(FragmentA=roundd.Rounded, FragmentB="%")
srf = Surface(crv_7)  # disabled
srf_2 = Surface(crv_6)  # disabled
srf_3 = Surface(crv_8)  # disabled
item_3 = ListItem(List=move.Geometry, Index=0, Wrap=True)
preview = CustomPreview(Geometry=srf_2, Material=swatch_2)  # disabled
preview_2 = CustomPreview(Geometry=srf_3, Material=swatch)  # disabled
preview_3 = CustomPreview(Geometry=srf, Material=swatch_3)  # disabled
concat_2 = Concatenate(FragmentA="The average repair successful rate: ", FragmentB=concat)
tag = TextTag3D(Location=item_3, Text=concat_2, Size=1, Colour=ColourSwatch(SwatchColor=RGB(0, 0, 0)), Justification=1)
