# Grasshopper definition debug_inputs.gh (Grasshopper 1.0.7)

folder = Panel("C:\Users\Ladybug Tools\Documents\hackathon\BoxStacker\data\vertices_as_nodes\")
concat = Concatenate(FragmentA=folder, FragmentB="13", FragmentC="_rooms.json")
concat_2 = Concatenate(FragmentA=folder, FragmentB="13", FragmentC="_in.json")
concat_3 = Concatenate(FragmentA=folder, FragmentB="13", FragmentC="_out.json")
path = FilePath(concat)
path_2 = FilePath(concat_2)
path_3 = FilePath(concat_3)
python = GhPythonScript(rooms_file=path, x=path_2, y=path_3)  # -> out, a, b
# ---------- python: Python ----------
from Rhino.Geometry import Point3d, Polyline

import json

with open(rooms_file) as rooms_f:
    room_data = json.load(rooms_f)

with open(x) as inf, open(y) as outf:
    in_data = [Point3d(p[0], p[1], 0) for p in json.load(inf)]
    out_data = [Point3d(p[0], p[1], 0) for p in json.load(outf)]

a = []
b = []
for _, room in room_data.items():
    vertices = [in_data[i] for i in room]
    vertices.append(in_data[room[0]])
    a.append(Polyline(vertices).ToNurbsCurve())

    vertices = [out_data[i] for i in room]
    vertices.append(out_data[room[0]])
    b.append(Polyline(vertices).ToNurbsCurve())
# ---------- end python ----------
panel = Panel(python.a)
panel_2 = Panel(python.b)
boundary = BoundarySurfaces(Edges=python.a)
boundary_2 = BoundarySurfaces(Edges=python.b)
preview = CustomPreview(
    Geometry=boundary,
    Material={diffuse=RGB(221, 160, 221), emission=RGB(66, 48, 66), shine=0.5, specular=RGB(255, 255, 255), transparency=0})
